# Grasshopper definition 01_froGH_File I-O.gh (Grasshopper 1.0.7)
# plug-ins: froGH

# froGH
path_type = ValueList({"Desktop": 0, "Documents": 1, "GH file path": 2, "C:": 3}, selected="Desktop")
f_pathg = PathGenerator(PathType=path_type, Subdir="my subdir")
f_ghfilepath = GHFilePathInfo()  # -> FileName, FilePath
panel = Panel(f_pathg)
gh_file_path = Panel(f_ghfilepath.FilePath)
# froGH - File I-O example file
# 
# Examples for the usage of froGH File I-O components
# 
# code by Alessio Erioli
# 
# v 0.1
# © Co-de-iT 2020 / Creative Commons Attribution-Non Commercial-ShareAlike 4.0 International License
gh_file_name = Panel(f_ghfilepath.FileName)
path_type_2 = ValueList({"Desktop": 0, "Documents": 1, "GH file path": 2, "C:": 3}, selected="Documents")
panel_2 = Panel("https://example-files.online-convert.com/document/txt/example.txt")
# Example: draw folder structure as a tree
panel_3 = Panel("radiolarian.stl")
f_ghfilepath_2 = GHFilePathInfo()  # -> FileName, FilePath
panel_4 = Panel("My Music")
depth_level = Slider(1, range=1..5)
depth_level_2 = Slider(0, range=0..5)
by_line = BooleanToggle(False)
concat = Concatenate(FragmentA=f_ghfilepath_2.FilePath, FragmentB=panel_3)
# Input a file path with nested directories and increase the depth level to show the directory structure tree diagram
f_pathg_2 = PathGenerator(PathType=path_type_2)
pt = Point(Point(38.03025384, 0, 0))
f_stlbinload = LoadSTLBinaryFile(FilePath=concat, WeldAngle=3.141592654)
f_urlr = ReadFileFromURL(URLAddress=panel_2, ByLine=by_line)
f_dirread = DirectoryReader(DirectoryPath=f_ghfilepath_2.FilePath, DepthLevel=depth_level_2)  # -> Subdirectories, Files
f_dirread_2 = DirectoryReader(DirectoryPath=f_pathg_2, DepthLevel=depth_level)  # -> Subdirectories, Files
cir = Circle(Plane=pt, Radius=Slider(10, range=10..100))
panel_5 = Panel(f_urlr)
panel_6 = Panel(f_dirread.Subdirectories)
panel_7 = Panel(f_dirread.Files)
f_dtg = DataTreeGraph(DataTree=f_dirread_2.Subdirectories, InscriptionCircle=cir)  # -> Twigs, Leaves, Arcs, TwigsText, LeavesText
X = UnitX(Factor="-20")
move = Move(Geometry=f_stlbinload, Motion=X)  # -> Geometry, Transform
preview = CustomPreview(Geometry=move.Geometry, Material=ColourSwatch(SwatchColor=RGB(255, 255, 255)))
parity = ValueList({"Even": 0, "Mark": 1, "None": 2, "Odd": 3, "Space": 4}, selected="None")
panel_8 = Panel("Lorem ipsum dolor sit amet, consectetur adipiscing elit. Integer bibendum arcu eu eros pellentesque, in pellentesque odio consectetur. Quisque ut auctor leo. Aliquam ultricies, erat id rutrum scelerisque, tellus ipsum lobortis augue, at tempus velit metus a enim. Donec ultrices eget ex nec dignissim. Quisque hendrerit sollicitudin libero facilisis malesuada. Vestibulum suscipit at velit venenatis hendrerit. Sed sed nibh eros. Nunc luctus imperdiet fringilla. Nunc consectetur dictum risus nec mollis. Nam vel hendrerit diam. Mauris enim tellus, consequat vel tellus non, pellentesque molestie ligula. Proin tincidunt quam est, a commodo justo hendrerit vitae. Mauris ligula ligula, maximus id nunc vel, scelerisque pulvinar leo. Donec at sollicitudin elit. Donec lorem arcu, vestibulum id sem id, varius aliquam lacus. Etiam risus massa, faucibus eget dui id, tempus lobortis nisi.")
f_ghfilepath_3 = GHFilePathInfo()  # -> FileName, FilePath
save = Button()
port = Panel("COM4")
send = Button()
baud_rate = Panel("57600")
bit_data = Panel("8")
pop2d = Populate2D(Region={Plane=PlaneXY(0, 0, 0), Size=Domain2(u=0..20, v=0..10)}, Count=Slider(10, range=10..30), Seed=1)
concat_2 = Concatenate(FragmentA=f_ghfilepath_3.FileName, FragmentB="_mod")
save_2 = Button()
lng = ListLength(List=pop2d)
f_fro = Froggle(Button=save)
range = Range(Domain="0.3 to 0.7", Steps=10)
repeat = RepeatData(Data="1", Length=lng)
f_compw = COMPortWriter(String="test string for COM port", Port=port, BAUDRate=baud_rate, Parity=parity, DataBits=bit_data, SendTrigger=send)
f_ghsave = SaveGHFile(FilePath=f_ghfilepath_3.FilePath, FileName=concat_2, Save=f_fro)  # -> SavedFilePath, SavedFileStatus
f_str2file = SaveStringToFile(String=panel_8, FilePath=f_ghfilepath_3.FilePath, FileName="Lorem Ipsum.txt", SaveTrigger=save_2)
metaball_t = MetaBallTCustom(Points=pop2d, Charge=repeat, Plane=PlaneXY(0, 0, 0), Threshold=range)  # -> simplify(Isocurve)
panel_9 = Panel(f_ghsave.SavedFilePath)
panel_10 = Panel(f_ghsave.SavedFileStatus)
panel_11 = Panel(f_compw)
tstat = TreeStatistics(Tree=metaball_t)  # -> Paths, Length, Count
wheel = ColourWheel(
    tstat.Count,
    ColourGrips_Style=10,
    ColourGrips_Grip=[5.373432149, 2.094395102, 4.188790205, 3.141592654],
    ColourGrips_Lum=[0.3795968538, 0.8795288145],
    ColourGrips_Range=[0.4183349123, 0.4183349123, 0.4183349123, 0.4183349123],
    ColourGrips_Sat=[0.2, 0.6])
f_ifromn = IndexesFromNumber(Amount=tstat.Count)
concat_3 = Concatenate(A="layer_", B=f_ifromn)  # -> simplify(graft(Result))
lng_2 = ListLength(List=metaball_t)
col = Colour(graft(wheel))
repeat_2 = RepeatData(Data=concat_3, Length=lng_2)
repeat_3 = RepeatData(Data=col, Length=lng_2)
preview_2 = CustomPreview(Geometry=metaball_t, Material=col)
export = Button()
toggle = BooleanToggle(True)
f_ghfilepath_4 = GHFilePathInfo()  # -> FileName, FilePath
f_aiexp = ExportCurvesToAI(
    Curves=flatten(metaball_t),
    Layer=flatten(repeat_2),
    LayerColor=flatten(repeat_3),
    PreserveUnits=toggle,
    ViewBound=Toggle(False),
    ColorStyle=toggle,
    SolidHatch=toggle,
    OrderLayers=toggle,
    FilePath=f_ghfilepath_4.FilePath,
    FileName="AI export Test",
    ExportTrigger=export)
