# Grasshopper definition 03_froGH_Mesh.gh (Grasshopper 1.0.7)
# plug-ins: froGH, Weaverbird, Kangaroo2 Components

srf = Surface(reparameterize(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))
Y = UnitY(Factor="80")
srf_2 = Surface(srf)
mesh_uv = MeshSurface(Surface=srf, UCount=Slider(40, range=5..50), VCount=Slider(20, range=5..20), Overhang=True, Equalize=False)
move = Move(Geometry=srf_2, Motion=Y)  # -> Geometry, Transform
dom² = ConstructDomain²(DomainU=Slider(0.718, range=0..1), DomainV=Slider(0.85, range=0..1))
alignvert = AlignVertices(Mesh=mesh_uv, Tolerance=0.01)  # -> Result, Count
weld = WeldMesh(Mesh=alignvert.Result, Angle=3.141592654)
subsrf = Isotrim(Surface=move.Geometry, Domain=dom²)
f_mrenorm = MeshRebuildNormals(Mesh=weld)
mesh_uv_2 = MeshSurface(Surface=subsrf, UCount=Slider(40, range=5..50), VCount=Slider(20, range=5..20), Overhang=True, Equalize=False)
# froGH - Mesh example file
# 
# Examples for the usage of froGH Mesh components
# 
# code by Alessio Erioli
# 
# v 0.1
# © Co-de-iT 2020 / Creative Commons Attribution-Non Commercial-ShareAlike 4.0 International License
# froGH
pt = Point(Point(-18.8024792, 28.93177084, 8.851091439))
face_index = Slider(93, range=0..100)
vertex_index = Slider(100, range=0..100)
edge_index = Slider(88, range=0..100)
mesh = Mesh(f_mrenorm)
alignvert_2 = AlignVertices(Mesh=mesh_uv_2, Tolerance=0.01)  # -> Result, Count
pt_2 = Point(Point(0, -16.62764235, 0))
weld_2 = WeldMesh(Mesh=alignvert_2.Result, Angle=3.141592654)
f_mrep = MeshReport(Mesh=weld_2)
f_mcvi = MeshClosestVertexIndex(Points=pt, Mesh=mesh)  # -> VertexIndex, VertexFaceIndex, FaceIndex
facen = FaceNormals(Mesh=mesh)  # -> Centers, Normals
f_mc_vpm = MeshConnectivityVertexProximityMap(Mesh=mesh)  # -> ConnectedVertices, ConnectedEdges, ConnectedFaces
f_mc_epm = MeshConnectivityEdgeProximityMap(Mesh=mesh)  # -> ConnectedVertices, ConnectedEdges, ConnectedFaces
f_mc_fpm = MeshConnectivityFaceProximityMap(Mesh=mesh)  # -> ConnectedVertices, ConnectedEdges, ConnectedFaces
f_mc_vps = MeshConnectivityVertexProximitySingle(Mesh=mesh, VertexIndex=vertex_index)  # -> ConnectedVertices, ConnectedEdges, ConnectedFaces
f_mc_eps = MeshConnectivityEdgeProximitySingle(Mesh=mesh, EdgeIndex=edge_index)  # -> ConnectedVertices, ConnectedEdges, ConnectedFaces
f_mc_fps = MeshConnectivityFaceProximitySingle(Mesh=mesh, FaceIndex=face_index)  # -> ConnectedVertices, ConnectedEdges, ConnectedFaces
f_mporient = MeshPointOrientation(Mesh=mesh, Points=pt_2)
f_medges = ExtractMeshEdges(Mesh=mesh)  # -> Edges, WeldStatus, EdgeStatus
demesh = DeconstructMesh(Mesh=mesh)  # -> Vertices, Faces, Colours, Normals
preview = CustomPreview(Geometry=weld_2, Material=ColourSwatch(SwatchColor=RGBA(69, 69, 69, 37)))
panel = Panel(f_mrep)
panel_2 = Panel(f_mporient)
item = ListItem(List=demesh.Vertices, Index=f_mcvi.VertexIndex, Wrap=True)
item_2 = ListItem(List=facen.Centers, Index=f_mcvi.FaceIndex, Wrap=True)
panel_3 = Panel(f_mc_fps.ConnectedVertices)
panel_4 = Panel(f_mc_eps.ConnectedEdges)
panel_5 = Panel(f_mc_fps.ConnectedEdges)
panel_6 = Panel(f_mc_fps.ConnectedFaces)

demesh_2 = DeconstructMesh(Mesh=mesh)  # -> Vertices, Faces, Colours, Normals
facen_2 = FaceNormals(Mesh=mesh)  # -> Centers, Normals
curvepoint = PointOnCurve(f_medges.Edges, parameter=0.5)
f_ifroml = IndexesFromList(Data=facen_2.Centers)
f_ifroml_2 = IndexesFromList(Data=demesh_2.Vertices)
f_ifroml_3 = IndexesFromList(Data=f_medges.Edges)
tag = TextTag3D(
    Location=curvepoint,
    Text=f_ifroml_3,
    Size=Slider(0.15, range=0..1),
    Colour=ColourSwatch(SwatchColor=RGB(255, 255, 255)),
    Justification=5)
tag_2 = TextTag3D(
    Location=demesh_2.Vertices,
    Text=f_ifroml_2,
    Size=Slider(0.2, range=0..1),
    Colour=ColourSwatch(SwatchColor=RGB(0, 0, 0)),
    Justification=5)
tag_3 = TextTag3D(
    Location=facen_2.Centers,
    Text=f_ifroml,
    Size=Slider(0.25, range=0..1),
    Colour=ColourSwatch(SwatchColor=RGB(255, 170, 0)),
    Justification=5)

item_3 = ListItem(List=f_medges.Edges, Index=edge_index, Wrap=True)
item_4 = ListItem(List=f_medges.Edges, Index=f_mc_eps.ConnectedEdges, Wrap=True)
pipe = Pipe(Curve=item_3, Radius="0.05", Caps=0)
pipe_2 = Pipe(Curve=item_4, Radius="0.02", Caps=0)
cap = CapHoles(Brep=pipe)
cap_2 = CapHoles(Brep=pipe_2)
preview_2 = CustomPreview(Geometry=cap, Material=ColourSwatch(SwatchColor=RGB(255, 0, 225)))
preview_3 = CustomPreview(Geometry=cap_2, Material=ColourSwatch(SwatchColor=RGB(255, 255, 255)))
X = UnitX(Factor="80")
mesh_2 = Mesh(mesh)
face_index_2 = Slider(93, range=0..100)
move_2 = Move(Geometry=mesh_2, Motion=X)  # -> Geometry, Transform
mesh_3 = Mesh(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)
wbcatmullclark = WeaverbirdsCatmullClarkSubdivision(MeshCurves=move_2.Geometry, Level="2", SmoothNakedEdges=1)
pt_3 = Point(Point(106.5291509, 2.194755413, -9.415765326))
pt_4 = Point(Point(61.38233494, 0, 14.18283124))
pt_5 = Point(Point(67.10441969, -19.52499178, -12.18137884))
f_mseea = MeshExtractEdgesWithToleranceAngle(Mesh=mesh_3, Angle=Slider(45, range=0..90))  # -> InternalEdges, NakedEdges
f_mfaces = ExtractMeshFaces(Mesh=mesh_2, FaceIndexes=face_index_2)
demesh_3 = DeconstructMesh(Mesh=wbcatmullclark)  # -> Vertices, Faces, Colours, Normals
sph = Sphere(Base=pt_5, Radius=Slider(16.74, range=0..50))
ln = Line(StartPoint=pt_3, EndPoint=pt_4)
Y_2 = UnitY(Factor="80")
preview_4 = CustomPreview(Geometry=mesh_3, Material=ColourSwatch(SwatchColor=RGB(82, 82, 82)))
geo = Geometry(sph)
geo_2 = Geometry(ln)
move_3 = Move(Geometry=wbcatmullclark, Motion=Y_2)  # -> Geometry, Transform
pull = PullPoint(Point=demesh_3.Vertices, Geometry=geo, ClosestOnly=True)  # -> ClosestPoint, Distance
pull_2 = PullPoint(Point=demesh_3.Vertices, Geometry=geo_2, ClosestOnly=True)  # -> ClosestPoint, Distance
preview_5 = CustomPreview(Geometry=f_mseea.InternalEdges, Material=ColourSwatch(SwatchColor=RGB(255, 255, 255)))
tri = Triangulate(Mesh=move_3.Geometry)  # -> Mesh, Count
division = Division(A=pull.Distance, B=pull_2.Distance)
# This component does the same but it's tailored for many meshes (as opposed to a single, large mesh)
f_mmeea = MeshesExtractEdgesWithToleranceAngle(Angle=45)  # -> InternalEdges, NakedEdges
demesh_4 = DeconstructMesh(Mesh=tri.Mesh)  # -> Vertices, Faces, Colours, Normals
atan = ArcTangent(Value=division)
num = Number(atan)
bnd = Bounds(Numbers=num)
remap = RemapNumbers(Value=num, Source=bnd, Target=Domain(0, 1))  # -> Mapped, Clipped
multiplication = Multiplication(A=remap.Mapped, B=Slider(80, range=0..100))
sin = Sine(Value=multiplication)
multiplication_2 = Multiplication(A=demesh_4.Normals, B=sin, C=Slider(1.5, range=0..3))
gradient = Gradient(LowerLimit=0, UpperLimit=1, Parameter=remap.Mapped, stops=[0: RGB(255, 255, 255), 1: RGB(0, 0, 0)])
move_4 = Move(Geometry=demesh_4.Vertices, Motion=multiplication_2)  # -> Geometry, Transform
conmesh = ConstructMesh(Vertices=move_4.Geometry, Faces=demesh_4.Faces)
f_mpc = MeshPseudoCurvature(Mesh=conmesh)
conmesh_2 = ConstructMesh(Vertices=demesh_3.Vertices, Faces=demesh_3.Faces, Colours=gradient)
bnd_2 = Bounds(Numbers=f_mpc)
dedomain = DeconstructDomain(Domain=bnd_2)  # -> Start, End
gradient_2 = Gradient(
    LowerLimit=dedomain.Start,
    UpperLimit=dedomain.End,
    Parameter=f_mpc,
    stops=[0: RGB(234, 38, 0), 0.386: RGB(234, 126, 0), 0.5: RGB(254, 244, 84), 0.607: RGB(173, 203, 249), 1: RGB(75, 107, 169)])
range = Range(Domain=Domain(0, 1), Steps=Slider(20, range=2..20))
f_miso = MeshIsocurves(Mesh=conmesh_2, ColorChannel=0, Isovalue=range)
preview_6 = CustomPreview(Geometry=f_miso, Material=ColourSwatch(SwatchColor=RGB(0, 255, 94)))
mcol = MeshColours(Mesh=conmesh, Colours=gradient_2)

# ---- group: build a mesh ring
pt_6 = Point(Point(480, 0, 0))
cir = Circle(Plane=pt_6, Radius="30")
Z = UnitZ(Factor="10")
extr = Extrude(Base=cir, Direction=Z)
mesh_uv_3 = MeshSurface(Surface=extr, UCount="1", VCount="15", Overhang=True, Equalize=False)

# ----
X_2 = UnitX(Factor="80*4")
mesh_4 = Mesh(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)
mesh_5 = Mesh(mesh_4)
move_5 = Move(Geometry=mesh_5, Motion=X_2)  # -> Geometry, Transform
panel_7 = Panel("""1
2
6""")
pt_7 = Point([Point(380, -25, 20), Point(430, -25, 0), Point(430, 25, 20), Point(380, 25, 0)])

# ---- group: add random noise
cluster = Cluster(M=mesh_4)

# ----
conmesh_3 = ConstructMesh(Vertices=pt_7, Faces={A=0, B=1, C=2, D=3})
mesh_6 = Mesh(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)
lng = ListLength(List=panel_7)
f_munl = MeshUnlooper(ClosedMeshStrip=mesh_uv_3, Displacement=Slider(0.001, range=0.001..1))
f_mdn = MeshDeNoising(Mesh=cluster, Iterations=panel_7)
f_mrenorm_2 = MeshRebuildNormals(Mesh=mesh_6)
f_submqf = MeshSubdivideQuadFaces(Mesh=conmesh_3, USubdivisions=Slider(5, range=5..50), VSubdivisions=Slider(5, range=5..50))
f_redmesh = ReduceMesh(
    Mesh=move_5.Geometry,
    ReductionRatio=Slider(0.786, range=0..1),
    Distortion=Toggle(True),
    Accuracy=Slider(8, range=1..10),
    NormalizeLength=Toggle(False))
series = Series(Start="1", Step=1, Count=lng)
Y_3 = UnitY(Factor="80")
f_mrep_2 = MeshReport(Mesh=f_munl)
unroller = Unroller(Strip=f_munl, Unroll=1)
multiplication_3 = Multiplication(A="80", B=series)
preview_7 = CustomPreview(Geometry=f_munl, Material=ColourSwatch(SwatchColor=RGB(255, 255, 255)))
move_6 = Move(Geometry=f_mrenorm_2, Motion=Y_3)  # -> Geometry, Transform
Y_4 = UnitY(Factor="80")
Y_5 = UnitY(Factor=multiplication_3)
panel_8 = Panel(f_mrep_2)
medges = MeshEdges(Mesh=f_submqf)  # -> NakedEdges, InteriorEdges, NonManifoldEdges
move_7 = Move(Geometry=f_redmesh, Motion=Y_4)  # -> Geometry, Transform
move_8 = Move(Geometry=f_mdn, Motion=Y_5)  # -> Geometry, Transform
preview_8 = CustomPreview(Geometry=f_submqf, Material=ColourSwatch(SwatchColor=RGB(255, 255, 255)))
preview_9 = CustomPreview(
    Geometry=mesh_6,
    Material={diffuse=RGB(221, 160, 221), emission=RGB(66, 48, 66), shine=0.5, specular=RGB(255, 255, 255), transparency=0})
preview_10 = CustomPreview(
    Geometry=move_6.Geometry,
    Material={diffuse=RGB(221, 160, 221), emission=RGB(66, 48, 66), shine=0.5, specular=RGB(255, 255, 255), transparency=0})
mesh_7 = Mesh([move_7.Geometry, move_5.Geometry])
medges_2 = MeshEdges(Mesh=mesh_7)  # -> NakedEdges, InteriorEdges, NonManifoldEdges
medges_3 = MeshEdges(Mesh=[move_8.Geometry, cluster])  # -> NakedEdges, InteriorEdges, NonManifoldEdges
preview_11 = CustomPreview(Geometry=mesh_7, Material=ColourSwatch(SwatchColor=RGB(255, 255, 255)))
preview_12 = CustomPreview(Geometry=[move_8.Geometry, cluster], Material=ColourSwatch(SwatchColor=RGB(255, 255, 255)))
Y_6 = UnitY(Factor="80")
X_3 = UnitX(Factor="80*5")
mesh_8 = Mesh(mesh_5)
move_9 = Move(Geometry=mesh_8, Motion=X_3)  # -> Geometry, Transform
move_10 = Move(Geometry=move_9.Geometry, Motion=Y_6)  # -> Geometry, Transform
demesh_5 = DeconstructMesh(Mesh=move_10.Geometry)  # -> Vertices, Faces, Colours, Normals
facen_3 = FaceNormals(Mesh=move_9.Geometry)  # -> Centers, Normals
pdecon = Deconstruct(Point=demesh_5.Vertices)  # -> XComponent, YComponent, ZComponent
vec = Vector(Vector(0.5773502692, 0.5773502692, 0.5773502692))
sqrt = SquareRoot(Value=pdecon.ZComponent)
angle = Angle(VectorA=facen_3.Normals, VectorB=vec)  # -> Angle, Reflex
mbox = MeshBox(
    Base={Plane=PlaneXY(0, 0, 0), X=Domain(-10, 10), Y=Domain(-10, 10), Z=Domain(-10, 10)},
    XCount="1",
    YCount="1",
    ZCount="1")
num_2 = Number(sqrt)
num_3 = Number(angle.Angle)
bnd_3 = Bounds(Numbers=num_2)
bnd_4 = Bounds(Numbers=num_3)
alignvert_3 = AlignVertices(Mesh=mbox, Tolerance=0.01)  # -> Result, Count
remap_2 = RemapNumbers(Value=num_2, Source=bnd_3, Target=Domain(0, 1))  # -> Mapped, Clipped
remap_3 = RemapNumbers(Value=num_3, Source=bnd_4, Target=Domain(0, 1))  # -> Mapped, Clipped
bar_graph = BarGraph(remap_3.Mapped, BarColor=RGB(255, 0, 90))
weld_3 = WeldMesh(Mesh=alignvert_3.Result, Angle=3.141592654)
bar_graph_2 = BarGraph(remap_2.Mapped, BarColor=RGB(255, 0, 90))
f_mf2vval = MeshFacesToVerticesValues(Mesh=move_9.Geometry, ValuesByFace=remap_3.Mapped, UseWeightedMethod=Toggle(False))
f_mv2fval = MeshVerticesToFacesValues(Mesh=move_10.Geometry, ValuesByVertex=remap_2.Mapped, UseWeightedMethod=Toggle(False))
f_m2cs = MeshToCSharpSnippet(Mesh=weld_3)
bar_graph_3 = BarGraph(f_mv2fval, BarColor=RGB(255, 0, 90))
gradient_3 = Gradient(
    LowerLimit=0,
    UpperLimit=1,
    Parameter=f_mf2vval,
    stops=[0: RGB(234, 38, 0), 0.25: RGB(234, 126, 0), 0.5: RGB(254, 244, 84), 0.75: RGB(173, 203, 249), 1: RGB(75, 107, 169)])
panel_9 = Panel(f_m2cs)
gradient_4 = Gradient(LowerLimit=0, UpperLimit=1, Parameter=f_mv2fval, stops=[0: RGB(0, 128, 0), 0.5: RGB(255, 255, 0), 1: RGB(255, 0, 0)])
bar_graph_4 = BarGraph(f_mf2vval, BarColor=RGB(255, 0, 90))

# ---- group: explode mesh
c_script = CSharpScript(M=move_10.Geometry)  # -> MF; inputs M: Mesh
# ---------- c_script: C# usings ----------
using System.Threading.Tasks;
# ---------- c_script: C# ----------
    if(M == null || !M.IsValid) return;

    Mesh[] exploded = new Mesh[M.Faces.Count];

    Parallel.For(0, M.Faces.Count, i =>
      {
      MeshFace f = M.Faces[i];
      Mesh mf = new Mesh();
      if (f.IsQuad)
      {
        mf.Vertices.Add(M.Vertices[f.A]);
        mf.Vertices.Add(M.Vertices[f.B]);
        mf.Vertices.Add(M.Vertices[f.C]);
        mf.Vertices.Add(M.Vertices[f.D]);
        mf.Faces.AddFace(0, 1, 2, 3);
      }
      else
      {
        mf.Vertices.Add(M.Vertices[f.A]);
        mf.Vertices.Add(M.Vertices[f.B]);
        mf.Vertices.Add(M.Vertices[f.C]);
        mf.Faces.AddFace(0, 1, 2);
      }
      exploded[i] = mf;

      });

    MF = exploded;
# ---------- end c_script ----------

# ----
mcol_2 = MeshColours(Mesh=move_9.Geometry, Colours=gradient_3)
mcol_3 = MeshColours(Mesh=graft(c_script), Colours=graft(gradient_4))
mjoin = MeshJoin(Meshes=flatten(mcol_3))

# ==== cluster Cluster
M = ClusterInput()
demesh = DeconstructMesh(Mesh=M)  # -> Vertices, Faces, Colours, Normals
lng = ListLength(List=demesh.Vertices)
random = Random(Range=Domain(0, 1), Number=lng, Seed=2)
multiplication = Multiplication(A=random, B=Slider(10, range=0..10))
Z = UnitZ(Factor=1)
amp = Amplitude(Vector=Z, Amplitude=multiplication)
move = Move(Geometry=demesh.Vertices, Motion=amp)  # -> Geometry, Transform
conmesh = ConstructMesh(Vertices=move.Geometry, Faces=demesh.Faces)
M_2 = ClusterOutput(conmesh)
