# Grasshopper definition 04_froGH_Mesh-Create.gh (Grasshopper 1.0.7)
# plug-ins: froGH, Weaverbird

pt = Point(Point(35, 0, 0))
# froGH
polyhedron_type = ValueList({"Bisymmetric Hendecahedron": 0, "Rhombic Dodecahedron": 1, "Sphenoid Hendecahedron": 2, "Truncated Octahedron": 3}, selected="Bisymmetric Hendecahedron")
pt_2 = Point([Point(145.0395486, -11.75605961, 8.252271974), Point(160.4398142, 64.99027965, -34.15734777), Point(139.6941217, -17.87525619, 85.60422645), Point(91.46549079, 46.19755247, 70.43644354), Point(91.87123859, 52.37851976, 13.58558507)])
cir = Circle(Plane=pt, Radius=Slider(10, range=1..10))
divide = DivideCurve(Curve=cir, Count=Slider(50, range=5..50), Kinks=False)  # -> Points, Tangents, Parameters
nurbs = NurbsCurve(Vertices=pt_2, Degree=3, Periodic=False)  # -> Curve, Length, Domain
pline = PolyLine(Vertices=divide.Points, Closed=Toggle(True))
pframes = PerpFrames(Curve=nurbs.Curve, Count=Slider(42, range=10..100), Align=True)  # -> Frames, Parameters
explode = Explode(Curve=pline, Recursive=True)  # -> Segments, Vertices
justification = ValueList({"TopLeft": 0, "TopCenter": 1, "TopRight": 2, "MiddleLeft": 3, "MiddleCenter": 4, "MiddleRight": 5, "BottomLeft": 6, "BottomCenter": 7, "BottomRight": 8}, selected="BottomLeft")
mesh = Mesh(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)
Y = UnitY(Factor="10")
# froGH - Mesh-Create example file
# 
# Examples for the usage of froGH Mesh-Create components
# 
# code by Alessio Erioli
# 
# v 0.1
# © Co-de-iT 2020 / Creative Commons Attribution-Non Commercial-ShareAlike 4.0 International License
number_slider = Slider(15, range=1..100)
scale_nu = ScaleNU(Geometry=explode.Vertices, Plane=pt, ScaleX=Slider(0.5, range=0.001..1), ScaleY=Slider(1, range=0.001..1), ScaleZ=1)  # -> Geometry, Transform
yz = YZPlane(Origin=cir)
number_slider_2 = Slider(0.86, range=0..1)
medges = MeshEdges(Mesh=mesh)  # -> NakedEdges, InteriorEdges, NonManifoldEdges
move = Move(Geometry=mesh, Motion=Y)  # -> Geometry, Transform
polygon = Polygon(Plane=pframes.Frames, Radius=Slider(4.981, range=1..10), Segments=Slider(6, range=3..10), FilletRadius=0)  # -> Polygon, Length
medges_2 = MeshEdges(Mesh=move.Geometry)  # -> NakedEdges, InteriorEdges, NonManifoldEdges
rotate = Rotate(Geometry=scale_nu.Geometry, Angle=Slider(1.571, range=0..1.571), Plane=yz)  # -> Geometry, Transform
pt_3 = Point(Point(10.29679552, 0, 0))
neg = Negative(Value=number_slider_2)
preview = CustomPreview(Geometry=[medges.InteriorEdges, medges_2.InteriorEdges], Material=ColourSwatch(SwatchColor=RGB(166, 166, 166)))
f_sphgen = SpaceFillingPolyhedraGenerator(BasePlane=PlaneXY(0, 0, 0), PolyhedronType=polyhedron_type, Scale=number_slider)  # -> Mesh, FacePolylines
f_t2geom = TextToGeometry(
    TextString="txt-smith",
    FontFace="Arial",
    Closed=True,
    Size="2",
    SamplingPrecision=50,
    BasePlane=pt_3,
    Justification=justification,
    TextOutputType="Polylines")
f_mbridge = MeshBridge(PonintsA=explode.Vertices, PonintsB=rotate.Geometry, Subdivisions=Slider(10, range=1..10))
f_meshoffsettheproperwaywhyisthisnotthen = MeshOffsetWeighted(Mesh=mesh, OffsetDistance=number_slider_2)  # -> Mesh, WeightedNormals; "f_MeshOffsetTheProperWayWhyIsThisNotTheNorm"
f_pmloft = PolylinesMeshLoft(Polylines=polygon.Polygon, Closed=Toggle(False))
wboffset = WeaverbirdsOffsetMesh(MeshCurves=move.Geometry, Distance=neg, OffsetType=0)
f_mrenorm = MeshRebuildNormals(Mesh=f_mbridge)
demesh = DeconstructMesh(Mesh=f_meshoffsettheproperwaywhyisthisnotthen.Mesh)  # -> Vertices, Faces, Colours, Normals
f_mrenorm_2 = MeshRebuildNormals(Mesh=f_pmloft)
demesh_2 = DeconstructMesh(Mesh=wboffset)  # -> Vertices, Faces, Colours, Normals
f_fmesh = FastMeshFromPolyline(Polylines=f_t2geom)
mmx = MeshMesh(MeshA=move.Geometry, MeshB=wboffset)
medges_3 = MeshEdges(Mesh=f_mbridge)  # -> NakedEdges, InteriorEdges, NonManifoldEdges
preview_2 = CustomPreview(Geometry=f_mrenorm, Material=ColourSwatch(SwatchColor=RGB(255, 255, 255)))
medges_4 = MeshEdges(Mesh=f_pmloft)  # -> NakedEdges, InteriorEdges, NonManifoldEdges
crv = Curve(f_sphgen.FacePolylines)
preview_3 = CustomPreview(Geometry=f_sphgen.Mesh, Material=ColourSwatch(SwatchColor=RGB(255, 255, 255)))
preview_4 = CustomPreview(Geometry=f_mrenorm_2, Material=ColourSwatch(SwatchColor=RGB(255, 255, 255)))
# check Front or Right parallel view in Rhino for this one
# Expected behavior (offset mesh is completely inside original)
vdisex = VectorDisplayEx(
    Point=demesh.Vertices,
    Vector=f_meshoffsettheproperwaywhyisthisnotthen.WeightedNormals,
    Colour=ColourSwatch(SwatchColor=RGB(255, 255, 255)),
    Width=2)
# Weird behavior: face normal average produces weird vertex normals in fringe cases (like this triangular prism with sharp extremities) and offset mesh intersects the original!
vdisex_2 = VectorDisplayEx(Point=demesh_2.Vertices, Vector=demesh_2.Normals, Colour=ColourSwatch(SwatchColor=RGB(255, 0, 0)), Width=3)
preview_5 = CustomPreview(Geometry=mmx, Material=ColourSwatch(SwatchColor=RGB(255, 242, 0)))
